# Grasshopper definition linear_regression.gh (Grasshopper 1.0.7)
# plug-ins: ghJSON, LunchBoxML

path = FilePath("C:\Users\reto\Documents\AECtech\MachineLearning\views4.json")
json = PythonScript(FilePath=path)  # -> out
# ---------- json: Python ----------
import json

if FilePath:
    
    # JSON file to read
    file = open(FilePath)
    
    # Load the data
    data = json.load(file)
    
    # Do something with the data
    print data
# ---------- end json ----------
panel = Panel(json)
frmjson = FromJSON(JSON=panel)
jpath = JSONPath(JObject=frmjson, JSONPathQuery="$..totalViews")
jpath_2 = JSONPath(JObject=frmjson, JSONPathQuery="$..createdOn")
flatten = FlattenTree(Tree=jpath, Path="{0}")
panel_2 = Panel(frmjson)
panel_3 = Panel(flatten)
split = TextSplit(Text=jpath_2, Separators=" ")
panel_4 = Panel("""/
:""")
split_2 = TextSplit(Text=split, Separators=panel_4)  # -> simplify(Result)
trim = TrimTree(Tree=split_2, Depth=1)
panel_5 = Panel(trim)
item = ListItem(List=panel_5, Index=0, Wrap=True)
item_2 = ListItem(List=panel_5, Index=1, Wrap=True)
item_3 = ListItem(List=panel_5, Index=2, Wrap=True)
item_4 = ListItem(List=panel_5, Index=3, Wrap=True)
item_5 = ListItem(List=panel_5, Index=4, Wrap=True)
item_6 = ListItem(List=panel_5, Index=5, Wrap=True)
date = ConstructDate(Year=item_3, Month=item, Day=item_2, Hour=item_4, Minute=item_5, Second=item_6)  # -> flatten(Date)
num = Number(date)
number_slider = Slider(570, range=0..1000)
bnd = Bounds(Numbers=num)
dom = ConstructDomain(DomainStart="0", DomainEnd=number_slider)
remap = RemapNumbers(Value=num, Source=bnd, Target=dom)  # -> Mapped, Clipped

# ---- group: X Test
series = Series(Start=0, Step=number_slider, Count=10)

# ----
linereg = LinearRegression(TestData=series, Inputs=remap.Mapped, Output=panel_3, RandomSeed=5)

# ---- group: LIne Plot
pt = ConstructPoint(XCoordinate=series, YCoordinate=linereg, ZCoordinate=0)
number_slider_2 = Slider(4, range=0..10)
swatch = ColourSwatch(SwatchColor=RGB(255, 255, 255))
pline = PolyLine(Vertices=pt, Closed=False)

# ----
pt_2 = ConstructPoint(XCoordinate=remap.Mapped, YCoordinate=panel_3, ZCoordinate=0)
pline_2 = PolyLine(Vertices=pt_2, Closed=False)
